# Grasshopper definition T03.1.gh (Grasshopper 1.0.8)

# ---- group: Gravity point
construct_point = ConstructPoint(XCoordinate=Slider(-16, range=-100..100), YCoordinate=Slider(-9, range=-100..100), ZCoordinate=0)

# ----
construct_point_2 = ConstructPoint(XCoordinate=Slider(-38, range=-100..100), YCoordinate=Slider(-41, range=-100..100), ZCoordinate=0)
xy_plane = XYPlane(Origin=construct_point_2)
hexagonal = Hexagonal(Plane=xy_plane, Size=Slider(3.5, range=0..10), ExtentX=Slider(15, range=0..100), ExtentY=Slider(15, range=0..100))  # -> Cells, Points
point = Point(flatten(hexagonal.Points))
distance = Distance(PointA=construct_point, PointB=point)
xy_plane_2 = XYPlane(Origin=point)
division = Division(A=distance, B=Slider(17.8, range=0..100))
circle = Circle(Plane=xy_plane_2, Radius=division)
