# Grasshopper definition T03.3.gh (Grasshopper 1.0.8)

construct_point = ConstructPoint(XCoordinate=Slider(-38, range=-100..100), YCoordinate=Slider(-41, range=-100..100), ZCoordinate=0)
xy_plane = XYPlane(Origin=construct_point)
curve = Curve(<curve referenced from the Rhino model>)
hexagonal = Hexagonal(Plane=xy_plane, Size=Slider(3.5, range=0..10), ExtentX=Slider(15, range=0..100), ExtentY=Slider(15, range=0..100))  # -> Cells, Points
point = Point(flatten(hexagonal.Points))
curve_closest_point = CurveClosestPoint(Point=point, Curve=curve)  # -> Point, Parameter, Distance
xy_plane_2 = XYPlane(Origin=point)
cluster_remap = ClusterRemap(data=curve_closest_point.Distance, min=Slider(0.2, range=0..1), max=Slider(3.5, range=0..10))
circle = Circle(Plane=xy_plane_2, Radius=cluster_remap)

# ==== cluster ClusterRemap
data = ClusterInput()
min = ClusterInput()
max = ClusterInput()
number = Number(data)
construct_domain = ConstructDomain(DomainStart=min, DomainEnd=max)
bounds = Bounds(Numbers=number)
remap_numbers = RemapNumbers(Value=data, Source=bounds, Target=construct_domain)  # -> Mapped, Clipped
data_2 = ClusterOutput(remap_numbers.Mapped)
