# Grasshopper definition T04.2.gh (Grasshopper 1.0.8)

construct_point = ConstructPoint(XCoordinate=Slider(-67, range=-100..100), YCoordinate=Slider(-67, range=-100..100), ZCoordinate=0)
curve = Curve(<curve referenced from the Rhino model>)
square = Square(Plane=construct_point, Size=Slider(6.7, range=0..10), ExtentX=Slider(20, range=0..100), ExtentY=Slider(20, range=0..100))  # -> Cells, Points

# ---- group: Pattern Shape
pattern = Curve(<curve referenced from the Rhino model>)
area = Area(Geometry=pattern)  # -> Area, Centroid

# ----
point = Point(flatten(square.Points))
curve_closest_point = CurveClosestPoint(Point=point, Curve=curve)  # -> Point, Parameter, Distance
orient = Orient(Geometry=pattern, Source=area.Centroid, Target=point)  # -> Geometry, Transform
number = Number(curve_closest_point.Distance)
cluster_remap = ClusterRemap(data=number, min=Slider(0.3, range=0..1), max=Slider(1.8, range=0..10))
scale = Scale(Geometry=orient.Geometry, Center=point, Factor=cluster_remap)  # -> Geometry, Transform
unit_z = UnitZ(Factor=1)
cluster_remap_2 = ClusterRemap(data=number, min=Slider(0, range=0..100), max=Slider(90, range=0..100))
rotate_3d = Rotate3D(Geometry=scale.Geometry, Angle=degrees(cluster_remap_2), Center=point, Axis=unit_z)  # -> Geometry, Transform
cluster_remap_3 = ClusterRemap(data=number, min=Slider(3, range=0..10), max=Slider(30, range=0..100))
unit_z_2 = UnitZ(Factor=cluster_remap_3)
move = Move(Geometry=rotate_3d.Geometry, Motion=unit_z_2)  # -> Geometry, Transform
rotate_3d_2 = Rotate3D(Geometry=move.Geometry, Angle=degrees(cluster_remap_2), Center=point, Axis=Vector(0, 0, 1))  # -> Geometry, Transform
move_2 = Move(Geometry=rotate_3d_2.Geometry, Motion=unit_z_2)  # -> Geometry, Transform
curve_2 = Curve(graft(rotate_3d.Geometry))
curve_3 = Curve(graft(move.Geometry))
curve_4 = Curve(graft(move_2.Geometry))
loft = Loft(
    Curves=[curve_2, curve_3, curve_4],
    Options={Adjust=False, Closed=False, LoftEnds=0, LoftSimp=1, LoftType=0, Rebuild=15, Refit=0.01})
cap_holes = CapHoles(Brep=loft)

# ==== cluster ClusterRemap
data = ClusterInput()
min = ClusterInput()
max = ClusterInput()
number = Number(data)
construct_domain = ConstructDomain(DomainStart=min, DomainEnd=max)
bounds = Bounds(Numbers=number)
remap_numbers = RemapNumbers(Value=data, Source=bounds, Target=construct_domain)  # -> Mapped, Clipped
data_2 = ClusterOutput(remap_numbers.Mapped)
