# Grasshopper definition T04.3.gh (Grasshopper 1.0.8)

construct_point = ConstructPoint(XCoordinate=Slider(-67, range=-100..100), YCoordinate=Slider(-67, range=-100..100), ZCoordinate=0)
curve = Curve(<curve referenced from the Rhino model>)
square = Square(Plane=construct_point, Size=Slider(6.7, range=0..10), ExtentX=Slider(20, range=0..100), ExtentY=Slider(20, range=0..100))  # -> Cells, Points

# ---- group: Pattern Shape
pattern = Curve(<curve referenced from the Rhino model>)
area = Area(Geometry=pattern)  # -> Area, Centroid

# ----
point = Point(flatten(square.Points))
curve_closest_point = CurveClosestPoint(Point=point, Curve=curve)  # -> Point, Parameter, Distance
orient = Orient(Geometry=pattern, Source=area.Centroid, Target=point)  # -> Geometry, Transform
vector_2pt = Vector2Pt(PointA=curve_closest_point.Point, PointB=point, Unitize=True)  # -> Vector, Length
number = Number(curve_closest_point.Distance)
cluster_remap = ClusterRemap(data=number, min=Slider(0.3, range=0..1), max=Slider(1.8, range=0..10))
unit_y = UnitY(Factor=1)
cluster_remap_2 = ClusterRemap(data=curve_closest_point.Distance, min=Slider(0, range=0..100), max=Slider(100, range=0..100))
scale = Scale(Geometry=orient.Geometry, Center=point, Factor=cluster_remap)  # -> Geometry, Transform
orient_direction = OrientDirection(Geometry=scale.Geometry, PointA=point, DirectionA=unit_y, PointB=point, DirectionB=vector_2pt.Vector)  # -> Geometry, Transform
smaller_than = SmallerThan(FirstNumber=cluster_remap_2, SecondNumber=Slider(12, range=0..50))  # -> SmallerThan, OrEqualTo
dispatch = Dispatch(List=orient_direction.Geometry, DispatchPattern=smaller_than.SmallerThan)  # -> ListA, ListB
cluster_remap_3 = ClusterRemap(data=curve_closest_point.Distance, min=Slider(5, range=0..10), max=Slider(40, range=0..100))
unit_z = UnitZ(Factor=cluster_remap_3)
curve_2 = Curve(dispatch.ListA)
curve_3 = Curve(dispatch.ListB)
boundary_surfaces = BoundarySurfaces(Edges=curve_3)
extrude = Extrude(Base=boundary_surfaces, Direction=unit_z)

# ==== cluster ClusterRemap
data = ClusterInput()
min = ClusterInput()
max = ClusterInput()
number = Number(data)
construct_domain = ConstructDomain(DomainStart=min, DomainEnd=max)
bounds = Bounds(Numbers=number)
remap_numbers = RemapNumbers(Value=data, Source=bounds, Target=construct_domain)  # -> Mapped, Clipped
data_2 = ClusterOutput(remap_numbers.Mapped)
