# Grasshopper definition T04.4.gh (Grasshopper 1.0.8)

construct_point = ConstructPoint(XCoordinate=Slider(-71, range=-100..100), YCoordinate=Slider(-71, range=-100..100), ZCoordinate=0)
curve = Curve(<curve referenced from the Rhino model>)
square = Square(Plane=construct_point, Size=Slider(7, range=0..10), ExtentX=Slider(20, range=0..100), ExtentY=Slider(20, range=0..100))  # -> Cells, Points
point = Point(flatten(square.Points))
curve_closest_point = CurveClosestPoint(Point=point, Curve=curve)  # -> Point, Parameter, Distance
cluster_remap = ClusterRemap(data=curve_closest_point.Distance, min=Slider(0, range=0..100), max=Slider(3, range=0..10))
point_2 = Point([<point referenced from the Rhino model> x4])
brep = Brep([<brep referenced from the Rhino model> x4])
integer = Integer(cluster_remap)
list_item = ListItem(List=brep, Index=integer, Wrap=True)
list_item_2 = ListItem(List=point_2, Index=integer, Wrap=True)
orient = Orient(Geometry=list_item, Source=list_item_2, Target=point)  # -> Geometry, Transform

# ==== cluster ClusterRemap
data = ClusterInput()
min = ClusterInput()
max = ClusterInput()
number = Number(data)
construct_domain = ConstructDomain(DomainStart=min, DomainEnd=max)
bounds = Bounds(Numbers=number)
remap_numbers = RemapNumbers(Value=data, Source=bounds, Target=construct_domain)  # -> Mapped, Clipped
data_2 = ClusterOutput(remap_numbers.Mapped)
