# Grasshopper definition T04.5.gh (Grasshopper 1.0.8)

construct_point = ConstructPoint(XCoordinate=Slider(-71, range=-100..100), YCoordinate=Slider(-71, range=-100..100), ZCoordinate=0)
square = Square(Plane=construct_point, Size=Slider(7, range=0..10), ExtentX=Slider(20, range=0..100), ExtentY=Slider(20, range=0..100))  # -> Cells, Points
point = Point(flatten(square.Points))
list_length = ListLength(List=point)
point_2 = Point([<point referenced from the Rhino model> x4])
brep = Brep([<brep referenced from the Rhino model> x4])
random = Random(Range=Domain(0, 3), Number=list_length, Seed=Slider(20, range=0..100))
integer = Integer(random)
list_item = ListItem(List=brep, Index=integer, Wrap=True)
list_item_2 = ListItem(List=point_2, Index=integer, Wrap=True)
orient = Orient(Geometry=list_item, Source=list_item_2, Target=point)  # -> Geometry, Transform
