# Grasshopper definition T05.1.gh (Grasshopper 1.0.8)
# plug-ins: LunchBox

pattern = Slider(1.9, range=0..10)
plane = Plane(PlaneXY(0, 0, 0))
circle = Circle(Plane=plane, Radius=Slider(20, range=0..100))
number = Number([Slider(4.6, range=0..10), Slider(4.7, range=0..10), Slider(8, range=0..10), Slider(1.8, range=0..10)])
list_length = ListLength(List=number)
multiplication = Multiplication(A=list_length, B=pattern)
perp_frames = PerpFrames(Curve=circle, Count=multiplication, Align=True)  # -> Frames, Parameters
deconstruct_plane = DeconstructPlane(Plane=perp_frames.Frames)  # -> Origin, XAxis, YAxis, ZAxis
repeat_data = RepeatData(Data=number, Length=multiplication)
number_slider = Slider(100, range=0..100)
multiplication_2 = Multiplication(A=deconstruct_plane.XAxis, B=repeat_data)
move = Move(Geometry=deconstruct_plane.Origin, Motion=multiplication_2)  # -> Geometry, Transform
control_knob = ControlKnob(Decimals=2, Limit=True, Maximum=10, Minimum=0, Range=10, Value=3)
number_slider_2 = Slider(9, range=0..100)
construct_domain = ConstructDomain(DomainStart=Slider(0, range=0..100), DomainEnd=number_slider)
number_slider_3 = Slider(0, range=0..100)
number_slider_4 = Slider(180, range=0..1000)
integer = Integer(control_knob)
interpolate = Interpolate(Vertices=move.Geometry, Degree=integer, Periodic=True, KnotStyle=1)  # -> Curve, Length, Domain
construct_domain_2 = ConstructDomain(DomainStart=number_slider_3, DomainEnd=number_slider_4)
range = Range(Domain=construct_domain, Steps=number_slider_2)
number_slider_5 = Slider(1, range=0..1)
number_slider_6 = Slider(0.5, range=0..10)
unit_z = UnitZ(Factor=range)
range_2 = Range(Domain=construct_domain_2, Steps=number_slider_2)
cluster_remap = ClusterRemap(data=range_2, min=0, max=1)
move_2 = Move(Geometry=interpolate.Curve, Motion=unit_z)  # -> Geometry, Transform
graph_mapper = GraphMapper(
    cluster_remap,
    x0=0,
    x1=1,
    y0=0,
    y1=1,
    container_name="Bezier",
    cpx=[0, 0.8005105853, 0.2975269258, 1],
    cpy=[0, 0.4556694627, 0.8307760358, 1])
construct_domain_3 = ConstructDomain(DomainStart=Slider(2, range=0..10), DomainEnd=Slider(5.2, range=0..10))
construct_domain_4 = ConstructDomain(DomainStart=number_slider_5, DomainEnd=number_slider_6)
area = Area(Geometry=move_2.Geometry)  # -> Area, Centroid
cluster_remap_2 = ClusterRemap(data=graph_mapper, min=number_slider_3, max=number_slider_4)
xy_plane = XYPlane(Origin=area.Centroid)
range_3 = Range(Domain=construct_domain_3, Steps=number_slider_2)
rotate_3d = Rotate3D(Geometry=move_2.Geometry, Angle=degrees(cluster_remap_2), Center=area.Centroid, Axis=Vector(0, 0, 1))  # -> Geometry, Transform
range_4 = Range(Domain=construct_domain, Steps=number_slider_2)
brep_plane = BrepPlane(Plane=xy_plane)  # -> Curves, Points
plane_2 = Plane(PlaneXY(0, 0, 0))
range_5 = Range(Domain=construct_domain_4, Steps=number_slider_2)
unit_z_2 = UnitZ(Factor=range_4)
circle_2 = Circle(Plane=plane_2, Radius=range_3)
cluster_remap_3 = ClusterRemap(data=range_5, min=0, max=1)
move_3 = Move(Geometry=circle_2, Motion=unit_z_2)  # -> Geometry, Transform
unit_z_3 = UnitZ(Factor=number_slider)
graph_mapper_2 = GraphMapper(
    cluster_remap_3,
    x0=0,
    x1=1,
    y0=0,
    y1=1,
    container_name="Sine",
    Equation_px=[0, 0.3566876948],
    Equation_py=[0, 0.6356912851])
extrude = Extrude(Base=circle_2, Direction=unit_z_3)
cluster_remap_4 = ClusterRemap(data=graph_mapper_2, min=number_slider_5, max=number_slider_6)
scale = Scale(Geometry=rotate_3d.Geometry, Center=area.Centroid, Factor=cluster_remap_4)  # -> Geometry, Transform
loft = Loft(Curves=scale.Geometry, Options={Adjust=False, Closed=False, LoftEnds=0, LoftSimp=0, LoftType=0, Rebuild=10, Refit=0.01})
diamond_panels = DiamondPanels(Surface=loft, UDivisions=Slider(30, range=0..100), VDivisions=Slider(54, range=0..100))  # -> DiamondPanels, TriPanels
perp_frame = PerpFrame(Curve=reparameterize(scale.Geometry), Parameter=Slider(0.3, range=0..1))
join_curves = JoinCurves(Curves=flatten(brep_plane.Curves), Preserve=False)
curve = Curve(scale.Geometry)
deconstruct_plane_2 = DeconstructPlane(Plane=perp_frame)  # -> Origin, XAxis, YAxis, ZAxis
curve_2 = Curve(graft(scale.Geometry))
curve_3 = Curve(graft(move_3.Geometry))
boundary_surfaces = BoundarySurfaces(Edges=[join_curves, curve])
brep = Brep(diamond_panels.DiamondPanels)
panel_frame = PanelFrame(Panel=diamond_panels.DiamondPanels, ScaleFactor=Slider(0.7, range=0..1))  # -> PanelFrame, Panel
curve_4 = Curve([curve_3, curve_2])
line_sdl = LineSDL(Start=deconstruct_plane_2.Origin, Direction=deconstruct_plane_2.XAxis, Length=Slider(-10, range=-10..10))
boundary_surfaces_2 = BoundarySurfaces(Edges=curve_4)
deconstruct = Deconstruct(Point=area.Centroid)  # -> XComponent, YComponent, ZComponent
number_slider_7 = Slider(90, range=0..100)
number_slider_8 = Slider(0, range=0..1)
unit_z_4 = UnitZ(Factor=Slider(1.5, range=0..10))
colour_picker = ColourPicker(PickedColour=RGB(43, 148, 95))
extrude_2 = Extrude(Base=boundary_surfaces_2, Direction=unit_z_4)
perp_frame_2 = PerpFrame(Curve=reparameterize(line_sdl), Parameter=Slider(1, range=0..1))
integer_2 = Integer(deconstruct.ZComponent)
deconstruct_plane_3 = DeconstructPlane(Plane=perp_frame_2)  # -> Origin, XAxis, YAxis, ZAxis
colour_picker_2 = ColourPicker(PickedColour=RGB(43, 53, 148))
create_material = CreateMaterial(
    Diffuse=colour_picker,
    Specular=RGB(255, 255, 255),
    Emission=RGB(0, 0, 0),
    Transparency=number_slider_8,
    Shine=number_slider_7)
construct_plane = ConstructPlane(Origin=deconstruct_plane_3.Origin, XAxis=deconstruct_plane_3.ZAxis, YAxis=deconstruct_plane_3.XAxis)
colour_picker_3 = ColourPicker(PickedColour=RGB(171, 134, 24))
create_material_2 = CreateMaterial(
    Diffuse=colour_picker_2,
    Specular=RGB(255, 255, 255),
    Emission=RGB(0, 0, 0),
    Transparency=number_slider_8,
    Shine=number_slider_7)
text_tag_3d = TextTag3D(Location=construct_plane, Text=integer_2, Size=Slider(2.1, range=0..10), Justification=7)
create_material_3 = CreateMaterial(
    Diffuse=colour_picker_3,
    Specular=RGB(255, 255, 255),
    Emission=RGB(0, 0, 0),
    Transparency=number_slider_8,
    Shine=number_slider_7)
surface = Surface(panel_frame.PanelFrame)
surface_2 = Surface(panel_frame.Panel)
brep_2 = Brep(loft)
brep_3 = Brep(extrude_2)
brep_4 = Brep(extrude)
create_material_4 = CreateMaterial(
    Diffuse=ColourSwatch(SwatchColor=RGB(136, 36, 138)),
    Specular=RGB(255, 255, 255),
    Emission=RGB(0, 0, 0),
    Transparency=number_slider_8,
    Shine=number_slider_7)
create_material_5 = CreateMaterial(
    Diffuse=ColourSwatch(SwatchColor=RGB(102, 133, 255)),
    Specular=RGB(255, 255, 255),
    Emission=RGB(0, 0, 0),
    Transparency=number_slider_8,
    Shine=number_slider_7)
custom_preview = CustomPreview(Geometry=surface_2, Material=create_material_4)
custom_preview_2 = CustomPreview(Geometry=surface, Material=create_material_5)
custom_preview_3 = CustomPreview(Material=create_material)
custom_preview_4 = CustomPreview(Material=create_material_2)
custom_preview_5 = CustomPreview(Material=create_material_3)

# ==== cluster ClusterRemap
data = ClusterInput()
min = ClusterInput()
max = ClusterInput()
number = Number(data)
construct_domain = ConstructDomain(DomainStart=min, DomainEnd=max)
bounds = Bounds(Numbers=number)
remap_numbers = RemapNumbers(Value=data, Source=bounds, Target=construct_domain)  # -> Mapped, Clipped
data_2 = ClusterOutput(remap_numbers.Mapped)
