# Grasshopper definition T06.1.gh (Grasshopper 1.0.8)

series = Series(Start=Slider(0, range=-100..100), Step=Slider(2.7, range=0..10), Count=Slider(30, range=0..100))
series_2 = Series(Start=Slider(0, range=-100..100), Step=Slider(2.5, range=0..10), Count=Slider(37, range=0..100))
series_3 = Series(Start=Slider(0, range=-100..100), Step=Slider(2.7, range=0..10), Count=Slider(30, range=0..100))
expression = Expression(x=series, a=Slider(8.8, range=0..10), Expression="a*sin(x)²*cos(x)")
expression_2 = Expression(x=series_2, a=Slider(4.1, range=0..10), Expression="a*sin(x)²*log(x)")
expression_3 = Expression(x=series_3, a=Slider(8.8, range=0..10), Expression="a*sin(x)³")
construct_point = ConstructPoint(XCoordinate=0, YCoordinate=series, ZCoordinate=expression)
construct_point_2 = ConstructPoint(XCoordinate=0, YCoordinate=series_2, ZCoordinate=expression_2)
construct_point_3 = ConstructPoint(XCoordinate=0, YCoordinate=series_3, ZCoordinate=expression_3)
control_knob = ControlKnob(Decimals=1, Limit=True, Maximum=11, Minimum=1, Range=1, Value=3)
control_knob_2 = ControlKnob(Decimals=1, Limit=True, Maximum=11, Minimum=1, Range=1, Value=3)
control_knob_3 = ControlKnob(Decimals=1, Limit=True, Maximum=11, Minimum=1, Range=1, Value=3)
interpolate = Interpolate(Vertices=construct_point, Degree=control_knob, Periodic=False, KnotStyle=1)  # -> Curve, Length, Domain
interpolate_2 = Interpolate(Vertices=construct_point_2, Degree=control_knob_2, Periodic=False, KnotStyle=1)  # -> Curve, Length, Domain
interpolate_3 = Interpolate(Vertices=construct_point_3, Degree=control_knob_3, Periodic=False, KnotStyle=1)  # -> Curve, Length, Domain
construct_point_4 = ConstructPoint(
    XCoordinate=Slider(48, range=-100..100),
    YCoordinate=Slider(-4, range=-100..100),
    ZCoordinate=Slider(20, range=-100..100))
construct_point_5 = ConstructPoint(XCoordinate=Slider(-8, range=-100..100), YCoordinate=Slider(12, range=-100..100), ZCoordinate=Slider(6, range=-100..100))
construct_point_6 = ConstructPoint(
    XCoordinate=Slider(-63, range=-100..100),
    YCoordinate=Slider(6, range=-100..100),
    ZCoordinate=Slider(29, range=-100..100))
end_points = EndPoints(Curve=interpolate.Curve)  # -> Start, End
end_points_2 = EndPoints(Curve=interpolate_2.Curve)  # -> Start, End
end_points_3 = EndPoints(Curve=interpolate_3.Curve)  # -> Start, End
vector_2pt = Vector2Pt(PointA=end_points.Start, PointB=construct_point_4, Unitize=False)  # -> Vector, Length
vector_2pt_2 = Vector2Pt(PointA=end_points_2.Start, PointB=construct_point_5, Unitize=False)  # -> Vector, Length
vector_2pt_3 = Vector2Pt(PointA=end_points_3.Start, PointB=construct_point_6, Unitize=False)  # -> Vector, Length
move = Move(Geometry=interpolate.Curve, Motion=vector_2pt.Vector)  # -> Geometry, Transform
move_2 = Move(Geometry=interpolate_2.Curve, Motion=vector_2pt_2.Vector)  # -> Geometry, Transform
move_3 = Move(Geometry=interpolate_3.Curve, Motion=vector_2pt_3.Vector)  # -> Geometry, Transform
loft = Loft(
    Curves=[move_3.Geometry, move_2.Geometry, move.Geometry],
    Options={Adjust=False, Closed=False, LoftEnds=0, LoftSimp=1, LoftType=0, Rebuild=100, Refit=0.01})
