# Grasshopper definition T06.2.gh (Grasshopper 1.0.8)

gene_pool = GenePool(Decimals=0, Maximum=100, Minimum=0, Value=[0, 41, 100])
construct_point = ConstructPoint(XCoordinate=0, YCoordinate=0, ZCoordinate=gene_pool)
gene_pool_2 = GenePool(Decimals=2, Maximum=50, Minimum=0, Value=[21.42, 44.05, 23.31])
gene_pool_3 = GenePool(Decimals=0, Maximum=180, Minimum=0, Value=[63, 131, 89])
plane = Plane(construct_point)
circle = Circle(Plane=plane, Radius=gene_pool_2)
rotate_3d = Rotate3D(Geometry=circle, Angle=degrees(gene_pool_3), Center=construct_point, Axis=Vector(0, 0, 1))  # -> Geometry, Transform
divide_curve = DivideCurve(Curve=rotate_3d.Geometry, Count=Slider(42, range=0..100), Kinks=False)  # -> simplify(Points), Tangents, Parameters
flip_matrix = FlipMatrix(Data=divide_curve.Points)
interpolate = Interpolate(Vertices=flip_matrix, Degree=3, Periodic=False, KnotStyle=1)  # -> flatten(Curve), Length, Domain
plane_2 = Plane(PlaneYZ(0, 0, 0))
mirror = Mirror(Geometry=interpolate.Curve, Plane=plane_2)  # -> Geometry, Transform
loft = Loft(
    Curves=interpolate.Curve,
    Options={Adjust=False, Closed=True, LoftEnds=0, LoftSimp=0, LoftType=0, Rebuild=10, Refit=0.01})
list_item = ListItem(List=interpolate.Curve, Index=0, Wrap=True)
curve_curve = CurveCurve(CurveA=list_item, CurveB=mirror.Geometry)  # -> flatten(Points), ParamsA, ParamsB
deconstruct = Deconstruct(Point=curve_curve.Points)  # -> XComponent, YComponent, ZComponent
construct_point_2 = ConstructPoint(XCoordinate=0, YCoordinate=0, ZCoordinate=deconstruct.ZComponent)
distance = Distance(PointA=construct_point_2, PointB=curve_curve.Points)
circle_2 = Circle(Plane=construct_point_2, Radius=distance)
pull_curve = PullCurve(Curve=circle_2, Surface=loft)
pipe = Pipe(Curve=[pull_curve, mirror.Geometry, interpolate.Curve], Radius=Slider(0.5, range=0..1), Caps=0)
