# Grasshopper definition T06.3.gh (Grasshopper 1.0.8)

gene_pool = GenePool(Decimals=2, Maximum=1, Minimum=0, Value=[0, 1, 0.5])
curve = Curve([<curve referenced from the Rhino model> x3])
curve_2 = Curve(<curve referenced from the Rhino model>)
area = Area(Geometry=curve)  # -> Area, Centroid
perp_frame = PerpFrame(Curve=reparameterize(curve_2), Parameter=gene_pool)
gene_pool_2 = GenePool(Decimals=0, Maximum=180, Minimum=0, Value=[90, 90, 134])
rotate_plane = RotatePlane(Plane=perp_frame, Angle=gene_pool_2)
orient = Orient(Geometry=curve, Source=area.Centroid, Target=rotate_plane)  # -> Geometry, Transform
gene_pool_3 = GenePool(Decimals=2, Maximum=4, Minimum=0, Value=[1.84, 1.31, 1.04])
scale = Scale(Geometry=orient.Geometry, Center=rotate_plane, Factor=gene_pool_3)  # -> Geometry, Transform
sweep1 = Sweep1(Rail=curve_2, Sections=scale.Geometry, Miter=1)
cap_holes = CapHoles(Brep=sweep1)
