# Grasshopper definition T07.1.gh (Grasshopper 1.0.8)

plane = Plane(PlaneXY(0, 0, 0))
number_slider = Slider(10, range=0..100)
circle = Circle(Plane=plane, Radius=Slider(33.5, range=0..100))
integer = Integer(90)
perp_frames = PerpFrames(Curve=circle, Count=number_slider, Align=True)  # -> Frames, Parameters
multiplication = Multiplication(A=integer, B=Slider(3, range=0..10))
division = Division(A=multiplication, B=number_slider)
polygon = Polygon(Plane=perp_frames.Frames, Radius=Slider(5.9, range=0..10), Segments=Slider(5, range=0..10), FilletRadius=0)  # -> Polygon, Length
series = Series(Start=0, Step=division, Count=10)
number_slider_2 = Slider(1.1, range=0..10)
number_slider_3 = Slider(2, range=0..10)
radians = Radians(Degrees=series)
amplitude = Amplitude(Vector=perp_frames.Frames, Amplitude=Slider(5.5, range=0..10))
construct_domain = ConstructDomain(DomainStart=number_slider_2, DomainEnd=number_slider_3)
rotate = Rotate(Geometry=polygon.Polygon, Angle=radians, Plane=perp_frames.Frames)  # -> Geometry, Transform
range = Range(Domain=construct_domain, Steps=number_slider)
cluster_remap = ClusterRemap(data=range, min=0, max=1)
graph_mapper = GraphMapper(
    cluster_remap,
    x0=0,
    x1=1,
    y0=0,
    y1=1,
    container_name="Sine",
    Equation_px=[0, 0.5607441068],
    Equation_py=[0, 0.6202529669])
cluster_remap_2 = ClusterRemap(data=graph_mapper, min=number_slider_2, max=number_slider_3)
scale = Scale(Geometry=rotate.Geometry, Center=perp_frames.Frames, Factor=cluster_remap_2)  # -> Geometry, Transform
extrude = Extrude(Base=scale.Geometry, Direction=amplitude)

# ==== cluster ClusterRemap
data = ClusterInput()
min = ClusterInput()
max = ClusterInput()
number = Number(data)
construct_domain = ConstructDomain(DomainStart=min, DomainEnd=max)
bounds = Bounds(Numbers=number)
remap_numbers = RemapNumbers(Value=data, Source=bounds, Target=construct_domain)  # -> Mapped, Clipped
data_2 = ClusterOutput(remap_numbers.Mapped)
