# Grasshopper definition T07.2.gh (Grasshopper 1.0.8)

plane = Plane(PlaneXY(0, 0, 0))
number_slider = Slider(10, range=0..100)
circle = Circle(Plane=plane, Radius=Slider(33.5, range=0..100))
integer = Integer(90)
perp_frames = PerpFrames(Curve=circle, Count=number_slider, Align=True)  # -> Frames, Parameters
multiplication = Multiplication(A=integer, B=Slider(10, range=0..10))
division = Division(A=multiplication, B=number_slider)
polygon = Polygon(Plane=perp_frames.Frames, Radius=Slider(7.1, range=0..10), Segments=Slider(5, range=0..10), FilletRadius=0)  # -> Polygon, Length
series = Series(Start=0, Step=division, Count=10)
radians = Radians(Degrees=series)
rotate = Rotate(Geometry=polygon.Polygon, Angle=radians, Plane=perp_frames.Frames)  # -> Geometry, Transform
deconstruct_brep = DeconstructBrep(Brep=rotate.Geometry)  # -> Faces, Edges, simplify(Vertices)
list_item = ListItem(List=deconstruct_brep.Vertices, Index=Slider(0, range=0..4), Wrap=True)  # -> flatten(Item)
list_item_2 = ListItem(List=deconstruct_brep.Vertices, Index=Slider(1, range=0..4), Wrap=True)  # -> flatten(Item)
list_item_3 = ListItem(List=deconstruct_brep.Vertices, Index=Slider(2, range=0..4), Wrap=True)  # -> flatten(Item)
list_item_4 = ListItem(List=deconstruct_brep.Vertices, Index=Slider(3, range=0..4), Wrap=True)  # -> flatten(Item)
list_item_5 = ListItem(List=deconstruct_brep.Vertices, Index=Slider(4, range=0..4), Wrap=True)  # -> flatten(Item)
base = Base(deconstruct_brep.Vertices)
sphere = Sphere(Base=base, Radius=Slider(2, range=0..10))
interpolate = Interpolate(Vertices=deconstruct_brep.Vertices, Degree=1, Periodic=True, KnotStyle=1)  # -> Curve, Length, Domain
interpolate_2 = Interpolate(Vertices=list_item, Degree=3, Periodic=True, KnotStyle=1)  # -> Curve, Length, Domain
interpolate_3 = Interpolate(Vertices=list_item_2, Degree=3, Periodic=True, KnotStyle=1)  # -> Curve, Length, Domain
interpolate_4 = Interpolate(Vertices=list_item_3, Degree=3, Periodic=True, KnotStyle=1)  # -> Curve, Length, Domain
interpolate_5 = Interpolate(Vertices=list_item_4, Degree=3, Periodic=True, KnotStyle=1)  # -> Curve, Length, Domain
interpolate_6 = Interpolate(Vertices=list_item_5, Degree=3, Periodic=True, KnotStyle=1)  # -> Curve, Length, Domain
pipe = Pipe(
    Curve=[interpolate_6.Curve, interpolate_5.Curve, interpolate_4.Curve, interpolate_3.Curve, interpolate_2.Curve, interpolate.Curve],
    Radius=Slider(0.6, range=0..10),
    Caps=0)
