# Grasshopper definition T07.3.gh (Grasshopper 1.0.8)

construct_point = ConstructPoint(XCoordinate=Slider(0, range=-100..100), YCoordinate=Slider(0, range=-100..100), ZCoordinate=0)
polygon = Polygon(Plane=construct_point, Radius=Slider(31, range=0..100), Segments=3, FilletRadius=0)  # -> Polygon, Length
divide_curve = DivideCurve(Curve=polygon.Polygon, Count=6, Kinks=False)  # -> Points, Tangents, Parameters
point_list = PointList(Points=divide_curve.Points, Size=Slider(3.4, range=0..10))
integer = Integer(["1", "2"])
integer_2 = Integer("5")
integer_3 = Integer("4")
list_item = ListItem(List=divide_curve.Points, Index=integer, Wrap=True)
list_item_2 = ListItem(List=divide_curve.Points, Index=integer_2, Wrap=True)
list_item_3 = ListItem(List=divide_curve.Points, Index=integer_3, Wrap=True)
unit_z = UnitZ(Factor=Slider(66, range=0..100))
move = Move(Geometry=list_item_2, Motion=unit_z)  # -> Geometry, Transform
integer_4 = Integer(120)
integer_5 = Integer(3)
merge = Merge(Data1=list_item, Data2=list_item_3, Data3=move.Geometry)
series = Series(Start=0, Step=integer_4, Count=integer_5)
interpolate = Interpolate(Vertices=merge, Degree=3, Periodic=True, KnotStyle=1)  # -> Curve, Length, Domain
radians = Radians(Degrees=series)
rotate_3d = Rotate3D(Geometry=interpolate.Curve, Angle=radians, Center=Point(0, 0, 0), Axis=Vector(0, 0, 1))  # -> Geometry, Transform
join_curves = JoinCurves(Curves=rotate_3d.Geometry, Preserve=False)
number_slider = Slider(1.1, range=0..10)
number_slider_2 = Slider(2.5, range=0..10)
divide_curve_2 = DivideCurve(Curve=join_curves, Count=Slider(6, range=0..10), Kinks=False)  # -> Points, Tangents, Parameters
number_slider_3 = Slider(8, range=0..10)
interpolate_2 = Interpolate(Vertices=divide_curve_2.Points, Degree=3, Periodic=True, KnotStyle=1)  # -> Curve, Length, Domain
construct_domain = ConstructDomain(DomainStart=number_slider, DomainEnd=number_slider_2)
construct_domain_2 = ConstructDomain(DomainStart=Slider(0, range=0..100), DomainEnd=Slider(360, range=0..1000))
perp_frames = PerpFrames(Curve=interpolate_2.Curve, Count=number_slider_3, Align=True)  # -> Frames, Parameters
range = Range(Domain=construct_domain, Steps=10)
integer_6 = Integer(3)
cluster_remap = ClusterRemap(data=range, min=0, max=1)
range_2 = Range(Domain=construct_domain_2, Steps=number_slider_3)
polygon_2 = Polygon(Plane=perp_frames.Frames, Radius=Slider(2.8, range=0..10), Segments=integer_6, FilletRadius=0)  # -> Polygon, Length
graph_mapper = GraphMapper(cluster_remap, x0=0, x1=1, y0=0, y1=1, container_name="Sine", Equation_px=[0, 0.424295783], Equation_py=[0, 0.626086235])
radians_2 = Radians(Degrees=range_2)
rotate = Rotate(Geometry=polygon_2.Polygon, Angle=radians_2, Plane=perp_frames.Frames)  # -> Geometry, Transform
cluster_remap_2 = ClusterRemap(data=graph_mapper, min=number_slider, max=number_slider_2)
scale = Scale(Geometry=rotate.Geometry, Center=perp_frames.Frames, Factor=cluster_remap_2)  # -> Geometry, Transform
deconstruct_brep = DeconstructBrep(Brep=scale.Geometry)  # -> Faces, Edges, simplify(Vertices)
integer_7 = Integer(1)
integer_8 = Integer(0)
integer_9 = Integer(2)
list_item_4 = ListItem(List=deconstruct_brep.Vertices, Index=integer_8, Wrap=True)  # -> flatten(Item)
list_item_5 = ListItem(List=deconstruct_brep.Vertices, Index=integer_7, Wrap=True)  # -> flatten(Item)
list_item_6 = ListItem(List=deconstruct_brep.Vertices, Index=integer_9, Wrap=True)  # -> flatten(Item)
interpolate_3 = Interpolate(Vertices=list_item_4, Degree=3, Periodic=True, KnotStyle=1)  # -> Curve, Length, Domain
interpolate_4 = Interpolate(Vertices=deconstruct_brep.Vertices, Degree=1, Periodic=True, KnotStyle=1)  # -> Curve, Length, Domain
interpolate_5 = Interpolate(Vertices=list_item_5, Degree=3, Periodic=True, KnotStyle=1)  # -> Curve, Length, Domain
interpolate_6 = Interpolate(Vertices=list_item_6, Degree=3, Periodic=True, KnotStyle=1)  # -> Curve, Length, Domain
pipe = Pipe(
    Curve=[interpolate_4.Curve, interpolate_3.Curve, interpolate_5.Curve, interpolate_6.Curve],
    Radius=Slider(0.5, range=0..10),
    Caps=0)

# ==== cluster ClusterRemap
data = ClusterInput()
min = ClusterInput()
max = ClusterInput()
number = Number(data)
construct_domain = ConstructDomain(DomainStart=min, DomainEnd=max)
bounds = Bounds(Numbers=number)
remap_numbers = RemapNumbers(Value=data, Source=bounds, Target=construct_domain)  # -> Mapped, Clipped
data_2 = ClusterOutput(remap_numbers.Mapped)
