# Grasshopper definition T08.1.gh (Grasshopper 1.0.8)

number_slider = Slider(32, range=0..100)
plane = Plane(PlaneXY(0, 0, 0))
circle = Circle(Plane=plane, Radius=number_slider)
construct_point = ConstructPoint(XCoordinate=expr("-x", number_slider), YCoordinate=0, ZCoordinate=0)
divide_curve = DivideCurve(Curve=circle, Count=Slider(15, range=0..20), Kinks=False)  # -> Points, Tangents, Parameters
line = Line(StartPoint=plane, EndPoint=construct_point)
construct_point_2 = ConstructPoint(XCoordinate=0, YCoordinate=0, ZCoordinate=Slider(25, range=0..100))
divide_curve_2 = DivideCurve(Curve=line, Count=Slider(5, range=0..10), Kinks=False)  # -> Points, Tangents, Parameters
line_2 = Line(StartPoint=plane, EndPoint=divide_curve.Points)
line_3 = Line(StartPoint=construct_point_2, EndPoint=plane)
line_4 = Line(StartPoint=construct_point_2, EndPoint=construct_point)
number = Number(divide_curve_2.Points)
plane_2 = Plane(PlaneXY(0, 0, 0))
number_slider_2 = Slider(1.1, range=0..10)
circle_2 = Circle(Plane=plane_2, Radius=number)
vector_2pt = Vector2Pt(PointA=expr("-x", construct_point_2), PointB=construct_point, Unitize=False)  # -> Vector, Length
point_on_curve = PointOnCurve(line_4, parameter=0.562)
amplitude = Amplitude(Vector=vector_2pt.Vector, Amplitude=Slider(-5.3, range=-10..10))
offset_curve = OffsetCurve(Curve=line_2, Distance=expr("-x", number_slider_2), Corners=1)
offset_curve_2 = OffsetCurve(Curve=circle_2, Distance=expr("-x", number_slider_2), Corners=1)
offset_curve_3 = OffsetCurve(Curve=line_2, Distance=number_slider_2, Corners=1)
offset_curve_4 = OffsetCurve(Curve=circle_2, Distance=number_slider_2, Corners=1)
move = Move(Geometry=point_on_curve, Motion=amplitude)  # -> Geometry, Transform
interpolate = Interpolate(Vertices=[construct_point_2, move.Geometry, construct_point], Degree=3, Periodic=False, KnotStyle=1)  # -> Curve, Length, Domain
revolution = Revolution(Curve=interpolate.Curve, Axis=line_3, Domain=Domain(0, 6.283185307))
project = Project(Curve=[offset_curve_2, offset_curve_4], Brep=revolution, Direction=Vector(0, 0, 1))
project_2 = Project(Curve=[offset_curve_3, offset_curve], Brep=revolution, Direction=Vector(0, 0, 1))
loft = Loft(Curves=project, Options={Adjust=False, Closed=False, LoftEnds=0, LoftSimp=0, LoftType=0, Rebuild=10, Refit=0.01})
loft_2 = Loft(Curves=project_2, Options={Adjust=False, Closed=False, LoftEnds=0, LoftSimp=0, LoftType=0, Rebuild=10, Refit=0.01})
