# Grasshopper definition T08.2.gh (Grasshopper 1.0.8)

number_slider = Slider(60, range=0..100)
square = Square(Plane=PlaneXY(0, 0, 0), Size=Slider(2.5, range=0..10), ExtentX=number_slider, ExtentY=number_slider)  # -> Cells, Points
image_sampler = ImageSampler(square.Points, Filter="Colour", Interpolate=False, Umax=1, Umin=0, Vmax=1, Vmin=0, Wrap=1)
division = Division(A=image_sampler, B=Slider(0.675, range=0..1))
curve = Curve(<curve referenced from the Rhino model>)
area = Area(Geometry=curve)  # -> Area, Centroid
orient = Orient(Geometry=curve, Source=area.Centroid, Target=square.Points)  # -> Geometry, Transform
scale = Scale(Geometry=orient.Geometry, Center=square.Points, Factor=division)  # -> Geometry, Transform
