# Grasshopper definition T08.3.gh (Grasshopper 1.0.8)

construct_point = ConstructPoint(XCoordinate=Slider(-100, range=-100..100), YCoordinate=0, ZCoordinate=0)
unit_x = UnitX(Factor=Slider(200, range=0..200))
move = Move(Geometry=construct_point, Motion=unit_x)  # -> Geometry, Transform
line = Line(StartPoint=construct_point, EndPoint=move.Geometry)
unit_z = UnitZ(Factor=Slider(50, range=0..100))
number_slider = Slider(20, range=0..100)
divide_curve = DivideCurve(Curve=line, Count=Slider(20, range=0..100), Kinks=False)  # -> Points, Tangents, Parameters
move_2 = Move(Geometry=line, Motion=unit_z)  # -> Geometry, Transform
unit_z_2 = UnitZ(Factor=Slider(50, range=0..100))
divide_curve_2 = DivideCurve(Curve=move_2.Geometry, Count=number_slider, Kinks=False)  # -> Points, Tangents, Parameters
move_3 = Move(Geometry=move_2.Geometry, Motion=unit_z_2)  # -> Geometry, Transform
divide_curve_3 = DivideCurve(Curve=move_3.Geometry, Count=Slider(20, range=0..100), Kinks=False)  # -> Points, Tangents, Parameters
number_slider_2 = Slider(0, range=0..100)
number_slider_3 = Slider(180, range=0..1000)
rectangle = Rectangle(Plane=divide_curve.Points, XSize=Slider(5.5, range=0..10), YSize=Slider(2.6, range=0..10), Radius=0)  # -> graft(Rectangle), Length
construct_domain = ConstructDomain(DomainStart=number_slider_2, DomainEnd=number_slider_3)
rectangle_2 = Rectangle(Plane=divide_curve_2.Points, XSize=Slider(5.5, range=0..10), YSize=Slider(2.6, range=0..10), Radius=0)  # -> Rectangle, Length
range = Range(Domain=construct_domain, Steps=number_slider)
rectangle_3 = Rectangle(Plane=divide_curve_3.Points, XSize=Slider(5.5, range=0..10), YSize=Slider(2.6, range=0..10), Radius=0)  # -> graft(Rectangle), Length
cluster_remap = ClusterRemap(data=range, min=0, max=1)
graph_mapper = GraphMapper(
    cluster_remap,
    x0=0,
    x1=1,
    y0=0,
    y1=1,
    container_name="Sine",
    Equation_px=[0, 0.5362318754],
    Equation_py=[0, 0.1956521869])
cluster_remap_2 = ClusterRemap(data=graph_mapper, min=number_slider_2, max=number_slider_3)
radians = Radians(Degrees=cluster_remap_2)
rotate_3d = Rotate3D(Geometry=rectangle_2.Rectangle, Angle=radians, Center=divide_curve_2.Points, Axis=Vector(0, 0, 1))  # -> graft(Geometry), Transform
loft = Loft(
    Curves=[rectangle_3.Rectangle, rotate_3d.Geometry, rectangle.Rectangle],
    Options={Adjust=False, Closed=False, LoftEnds=0, LoftSimp=0, LoftType=0, Rebuild=10, Refit=0.01})

# ==== cluster ClusterRemap
data = ClusterInput()
min = ClusterInput()
max = ClusterInput()
number = Number(data)
construct_domain = ConstructDomain(DomainStart=min, DomainEnd=max)
bounds = Bounds(Numbers=number)
remap_numbers = RemapNumbers(Value=data, Source=bounds, Target=construct_domain)  # -> Mapped, Clipped
data_2 = ClusterOutput(remap_numbers.Mapped)
