# Grasshopper definition T10.1.gh (Grasshopper 1.0.8)

number_slider = Slider(19, range=0..100)
number_slider_2 = Slider(4, range=0..100)
series = Series(Start=0, Step=number_slider, Count=number_slider_2)
construct_point = ConstructPoint(XCoordinate=series, YCoordinate=0, ZCoordinate=0)
point = Point(construct_point)
list_item = ListItem(List=reverse(point), Index=0, Wrap=True)
list_item_2 = ListItem(List=point, Index=0, Wrap=True)
series_2 = Series(Start=list_item_2, Step=number_slider, Count=number_slider_2)
distance = Distance(PointA=list_item, PointB=list_item_2)
construct_point_2 = ConstructPoint(XCoordinate=0, YCoordinate=series_2, ZCoordinate=0)
unit_y = UnitY(Factor=distance)
point_2 = Point(construct_point_2)
move = Move(Geometry=point, Motion=unit_y)  # -> Geometry, Transform
list_item_3 = ListItem(List=reverse(point_2), Index=0, Wrap=True)
list_item_4 = ListItem(List=point_2, Index=0, Wrap=True)
distance_2 = Distance(PointA=list_item_3, PointB=list_item_4)
gene_pool = GenePool(Decimals=0, Maximum=40, Minimum=0, Value=[23, 17])
gene_pool_2 = GenePool(Decimals=0, Maximum=40, Minimum=0, Value=[19, 23, 22])
gene_pool_3 = GenePool(Decimals=0, Maximum=40, Minimum=0, Value=[23, 23, 18, 23])
gene_pool_4 = GenePool(Decimals=0, Maximum=40, Minimum=0, Value=[22, 26, 20])
unit_x = UnitX(Factor=distance_2)
unit_z = UnitZ(Factor=gene_pool)
list_item_5 = ListItem(List=reverse(gene_pool_3), Index=0, Wrap=True)
move_2 = Move(Geometry=point_2, Motion=unit_x)  # -> Geometry, Transform
unit_z_2 = UnitZ(Factor=gene_pool_4)
list_item_6 = ListItem(List=gene_pool_3, Index=0, Wrap=True)
list_item_7 = ListItem(List=gene_pool_4, Index=0, Wrap=True)
list_item_8 = ListItem(List=gene_pool_2, Index=0, Wrap=True)
unit_z_3 = UnitZ(Factor=[list_item_5, unit_z])
unit_z_4 = UnitZ(Factor=reverse(gene_pool_2))
unit_z_5 = UnitZ(Factor=gene_pool_3)
unit_z_6 = UnitZ(Factor=list_item_6)
unit_z_7 = UnitZ(Factor=list_item_8)
unit_z_8 = UnitZ(Factor=list_item_7)
move_3 = Move(Geometry=reverse(move.Geometry), Motion=[unit_z_3, unit_z_7])  # -> Geometry, Transform
move_4 = Move(Geometry=move_2.Geometry, Motion=unit_z_5)  # -> Geometry, Transform
move_5 = Move(Geometry=point_2, Motion=[unit_z_8, unit_z_4])  # -> Geometry, Transform
move_6 = Move(Geometry=point, Motion=[unit_z_2, unit_z_6])  # -> Geometry, Transform
interpolate = Interpolate(Vertices=move_4.Geometry, Degree=3, Periodic=False, KnotStyle=1)  # -> Curve, Length, Domain
interpolate_2 = Interpolate(Vertices=move_3.Geometry, Degree=3, Periodic=False, KnotStyle=1)  # -> Curve, Length, Domain
interpolate_3 = Interpolate(Vertices=move_5.Geometry, Degree=3, Periodic=False, KnotStyle=1)  # -> Curve, Length, Domain
interpolate_4 = Interpolate(Vertices=move_6.Geometry, Degree=3, Periodic=False, KnotStyle=1)  # -> Curve, Length, Domain
network_surface = NetworkSurface(CurvesU=[interpolate_3.Curve, interpolate.Curve], CurvesV=[interpolate_4.Curve, interpolate_2.Curve], Continuity=2)
md_slider = MDSlider(
    SliderMode=0,
    slider_value=Point(0.5351071241, 0.1400678681, 0.5),
    x_domain=Domain(0, 1),
    y_domain=Domain(0, 1),
    z_domain=Domain(0, 1))
md_slider_2 = MDSlider(
    SliderMode=0,
    slider_value=Point(0.7928332817, 0.629832198, 0.5),
    x_domain=Domain(0, 1),
    y_domain=Domain(0, 1),
    z_domain=Domain(0, 1))
md_slider_3 = MDSlider(
    SliderMode=0,
    slider_value=Point(0.2917391149, 0.5010655101, 0.5),
    x_domain=Domain(0, 1),
    y_domain=Domain(0, 1),
    z_domain=Domain(0, 1))
surface = Surface(reparameterize(network_surface))
divide_domain² = DivideDomain²(Domain=surface, UCount=Slider(12, range=0..100), VCount=Slider(12, range=0..100))
evaluate_surface = EvaluateSurface(Surface=reparameterize(surface), Point=[md_slider_3, md_slider, md_slider_2])  # -> Point, Normal, UDirection, VDirection, Frame
isotrim = Isotrim(Surface=surface, Domain=divide_domain²)
area = Area(Geometry=isotrim)  # -> Area, Centroid
deconstruct_brep = DeconstructBrep(Brep=isotrim)  # -> simplify(Faces), simplify(Edges), simplify(Vertices)
distance_3 = Distance(PointA=evaluate_surface.Point, PointB=graft(area.Centroid))  # -> simplify(Distance)
sort_list = SortList(Keys=distance_3)  # -> Keys, ValuesValuesA
area_2 = Area(Geometry=deconstruct_brep.Faces)  # -> Area, Centroid
join_curves = JoinCurves(Curves=deconstruct_brep.Edges, Preserve=False)
list_item_9 = ListItem(List=sort_list.Keys, Index=0, Wrap=True)  # -> flatten(Item)
bounds = Bounds(Numbers=list_item_9)
construct_domain = ConstructDomain(DomainStart=Slider(0.05, range=0..10), DomainEnd=Slider(0.9, range=0..10))
remap_numbers = RemapNumbers(Value=list_item_9, Source=bounds, Target=construct_domain)  # -> graft(Mapped), Clipped
scale = Scale(Geometry=simplify(join_curves), Center=area_2.Centroid, Factor=remap_numbers.Mapped)  # -> Geometry, Transform
curve = Curve(simplify(join_curves))
curve_2 = Curve(simplify(scale.Geometry))
curve_3 = Curve([curve, curve_2])
loft = Loft(Curves=curve_3, Options={Adjust=False, Closed=False, LoftEnds=0, LoftSimp=0, LoftType=0, Rebuild=10, Refit=0.01})
