# Grasshopper definition T11.2.gh (Grasshopper 1.0.8)

number_slider = Slider(19, range=0..100)
number_slider_2 = Slider(4, range=0..100)
series = Series(Start=0, Step=number_slider, Count=number_slider_2)
construct_point = ConstructPoint(XCoordinate=series, YCoordinate=0, ZCoordinate=0)
point = Point(construct_point)
list_item = ListItem(List=reverse(point), Index=0, Wrap=True)
list_item_2 = ListItem(List=point, Index=0, Wrap=True)
series_2 = Series(Start=list_item_2, Step=number_slider, Count=number_slider_2)
distance = Distance(PointA=list_item, PointB=list_item_2)
construct_point_2 = ConstructPoint(XCoordinate=0, YCoordinate=series_2, ZCoordinate=0)
unit_y = UnitY(Factor=distance)
point_2 = Point(construct_point_2)
move = Move(Geometry=point, Motion=unit_y)  # -> Geometry, Transform
list_item_3 = ListItem(List=reverse(point_2), Index=0, Wrap=True)
list_item_4 = ListItem(List=point_2, Index=0, Wrap=True)
distance_2 = Distance(PointA=list_item_3, PointB=list_item_4)
gene_pool = GenePool(Decimals=0, Maximum=40, Minimum=0, Value=[23, 17])
gene_pool_2 = GenePool(Decimals=0, Maximum=40, Minimum=0, Value=[19, 23, 22])
gene_pool_3 = GenePool(Decimals=0, Maximum=40, Minimum=0, Value=[23, 26, 18, 23])
gene_pool_4 = GenePool(Decimals=0, Maximum=40, Minimum=0, Value=[22, 26, 20])
unit_x = UnitX(Factor=distance_2)
unit_z = UnitZ(Factor=gene_pool)
list_item_5 = ListItem(List=reverse(gene_pool_3), Index=0, Wrap=True)
move_2 = Move(Geometry=point_2, Motion=unit_x)  # -> Geometry, Transform
unit_z_2 = UnitZ(Factor=gene_pool_4)
list_item_6 = ListItem(List=gene_pool_3, Index=0, Wrap=True)
list_item_7 = ListItem(List=gene_pool_4, Index=0, Wrap=True)
list_item_8 = ListItem(List=gene_pool_2, Index=0, Wrap=True)
unit_z_3 = UnitZ(Factor=[list_item_5, unit_z])
unit_z_4 = UnitZ(Factor=reverse(gene_pool_2))
unit_z_5 = UnitZ(Factor=gene_pool_3)
unit_z_6 = UnitZ(Factor=list_item_6)
unit_z_7 = UnitZ(Factor=list_item_8)
unit_z_8 = UnitZ(Factor=list_item_7)
move_3 = Move(Geometry=reverse(move.Geometry), Motion=[unit_z_3, unit_z_7])  # -> Geometry, Transform
move_4 = Move(Geometry=move_2.Geometry, Motion=unit_z_5)  # -> Geometry, Transform
move_5 = Move(Geometry=point_2, Motion=[unit_z_8, unit_z_4])  # -> Geometry, Transform
move_6 = Move(Geometry=point, Motion=[unit_z_2, unit_z_6])  # -> Geometry, Transform
interpolate = Interpolate(Vertices=move_4.Geometry, Degree=3, Periodic=False, KnotStyle=1)  # -> Curve, Length, Domain
interpolate_2 = Interpolate(Vertices=move_3.Geometry, Degree=3, Periodic=False, KnotStyle=1)  # -> Curve, Length, Domain
interpolate_3 = Interpolate(Vertices=move_5.Geometry, Degree=3, Periodic=False, KnotStyle=1)  # -> Curve, Length, Domain
interpolate_4 = Interpolate(Vertices=move_6.Geometry, Degree=3, Periodic=False, KnotStyle=1)  # -> Curve, Length, Domain
number_slider_3 = Slider(12, range=0..100)
number_slider_4 = Slider(12, range=0..100)
network_surface = NetworkSurface(CurvesU=[interpolate_3.Curve, interpolate.Curve], CurvesV=[interpolate_4.Curve, interpolate_2.Curve], Continuity=2)
md_slider = MDSlider(
    SliderMode=0,
    slider_value=Point(0.5351071241, 0.1400678681, 0.5),
    x_domain=Domain(0, 1),
    y_domain=Domain(0, 1),
    z_domain=Domain(0, 1))
md_slider_2 = MDSlider(
    SliderMode=0,
    slider_value=Point(0.7928332817, 0.629832198, 0.5),
    x_domain=Domain(0, 1),
    y_domain=Domain(0, 1),
    z_domain=Domain(0, 1))
md_slider_3 = MDSlider(
    SliderMode=0,
    slider_value=Point(0.2917391149, 0.5010655101, 0.5),
    x_domain=Domain(0, 1),
    y_domain=Domain(0, 1),
    z_domain=Domain(0, 1))
surface = Surface(reparameterize(network_surface))
divide_domain² = DivideDomain²(Domain=surface, UCount=number_slider_3, VCount=number_slider_4)
evaluate_surface = EvaluateSurface(Surface=reparameterize(surface), Point=[md_slider_3, md_slider, md_slider_2])  # -> Point, Normal, UDirection, VDirection, Frame
isotrim = Isotrim(Surface=surface, Domain=divide_domain²)
area = Area(Geometry=isotrim)  # -> Area, Centroid
deconstruct_brep = DeconstructBrep(Brep=isotrim)  # -> simplify(Faces), simplify(Edges), simplify(Vertices)
distance_3 = Distance(PointA=evaluate_surface.Point, PointB=graft(area.Centroid))  # -> simplify(Distance)
area_2 = Area(Geometry=deconstruct_brep.Faces)  # -> Area, Centroid
cluster = Cluster(point=deconstruct_brep.Vertices)  # -> _0, _1, _2, _3
sort_list = SortList(Keys=distance_3)  # -> Keys, ValuesValuesA
list_item_9 = ListItem(List=sort_list.Keys, Index=0, Wrap=True)  # -> flatten(Item)
_4point_surface = _4PointSurface(CornerA=cluster._0, CornerB=cluster._1, CornerC=area_2.Centroid)
_4point_surface_2 = _4PointSurface(CornerA=cluster._1, CornerB=cluster._2, CornerC=area_2.Centroid)
_4point_surface_3 = _4PointSurface(CornerA=cluster._2, CornerB=cluster._3, CornerC=area_2.Centroid)
_4point_surface_4 = _4PointSurface(CornerA=cluster._3, CornerB=cluster._0, CornerC=area_2.Centroid)
bounds = Bounds(Numbers=list_item_9)
construct_domain = ConstructDomain(DomainStart=Slider(-10, range=-1000..1000), DomainEnd=Slider(-60, range=-1000..1000))
surface_2 = Surface(simplify(_4point_surface_2))
surface_3 = Surface(simplify(_4point_surface_3))
surface_4 = Surface(simplify(_4point_surface_4))
surface_5 = Surface(simplify(_4point_surface))
remap_numbers = RemapNumbers(Value=list_item_9, Source=bounds, Target=construct_domain)  # -> graft(Mapped), Clipped
deconstruct_brep_2 = DeconstructBrep(Brep=surface_5)  # -> simplify(Faces), simplify(Edges), simplify(Vertices)
deconstruct_brep_3 = DeconstructBrep(Brep=surface_2)  # -> simplify(Faces), simplify(Edges), simplify(Vertices)
deconstruct_brep_4 = DeconstructBrep(Brep=surface_3)  # -> simplify(Faces), simplify(Edges), simplify(Vertices)
deconstruct_brep_5 = DeconstructBrep(Brep=surface_4)  # -> simplify(Faces), simplify(Edges), simplify(Vertices)
radians = Radians(Degrees=remap_numbers.Mapped)
radians_2 = Radians(Degrees=remap_numbers.Mapped)
radians_3 = Radians(Degrees=remap_numbers.Mapped)
radians_4 = Radians(Degrees=remap_numbers.Mapped)
list_item_10 = ListItem(List=deconstruct_brep_2.Edges, Index=0, Wrap=True)
list_item_11 = ListItem(List=deconstruct_brep_3.Edges, Index=0, Wrap=True)
list_item_12 = ListItem(List=deconstruct_brep_4.Edges, Index=0, Wrap=True)
list_item_13 = ListItem(List=deconstruct_brep_5.Edges, Index=0, Wrap=True)
rotate_axis = RotateAxis(Geometry=surface_5, Angle=radians, Axis=list_item_10)  # -> simplify(Geometry), Transform
rotate_axis_2 = RotateAxis(Geometry=surface_2, Angle=radians_2, Axis=list_item_11)  # -> simplify(Geometry), Transform
rotate_axis_3 = RotateAxis(Geometry=surface_3, Angle=radians_3, Axis=list_item_12)  # -> simplify(Geometry), Transform
rotate_axis_4 = RotateAxis(Geometry=surface_4, Angle=radians_4, Axis=list_item_13)  # -> simplify(Geometry), Transform
deconstruct_brep_6 = DeconstructBrep(Brep=rotate_axis.Geometry)  # -> simplify(Faces), simplify(Edges), simplify(Vertices)
deconstruct_brep_7 = DeconstructBrep(Brep=rotate_axis_2.Geometry)  # -> simplify(Faces), simplify(Edges), simplify(Vertices)
deconstruct_brep_8 = DeconstructBrep(Brep=rotate_axis_4.Geometry)  # -> simplify(Faces), simplify(Edges), simplify(Vertices)
deconstruct_brep_9 = DeconstructBrep(Brep=rotate_axis_3.Geometry)  # -> simplify(Faces), simplify(Edges), simplify(Vertices)
cluster_2 = Cluster_2(point=deconstruct_brep_6.Vertices)  # -> _0, _1, _2
cluster_3 = Cluster_2(point=deconstruct_brep_7.Vertices)  # -> _0, _1, _2
cluster_4 = Cluster_2(point=deconstruct_brep_9.Vertices)  # -> _0, _1, _2
cluster_5 = Cluster_2(point=deconstruct_brep_8.Vertices)  # -> _0, _1, _2
_4point_surface_5 = _4PointSurface(CornerA=cluster_2._2, CornerB=cluster_3._2, CornerC=cluster_4._2, CornerD=cluster_5._2)
area_3 = Area(Geometry=_4point_surface_5)  # -> Area, Centroid
plane = Plane(Plane(origin=(-55.04841925, -19.21889666, 0), x=(0, -1, 0), y=(1, 0, 0)))
plane_surface = PlaneSurface(Plane=plane, XSize=Slider(300, range=0..300), YSize=Slider(300, range=0..300))
_4point_surface_6 = _4PointSurface(CornerA=cluster_2._1, CornerB=cluster_2._2, CornerC=area_3.Centroid)  # -> simplify(Surface)
_4point_surface_7 = _4PointSurface(CornerA=cluster_3._1, CornerB=cluster_3._2, CornerC=area_3.Centroid)  # -> simplify(Surface)
_4point_surface_8 = _4PointSurface(CornerA=cluster_4._1, CornerB=cluster_4._2, CornerC=area_3.Centroid)  # -> simplify(Surface)
_4point_surface_9 = _4PointSurface(CornerA=cluster_5._1, CornerB=cluster_5._2, CornerC=area_3.Centroid)  # -> simplify(Surface)
_4point_surface_10 = _4PointSurface(CornerA=cluster._0, CornerB=cluster._1, CornerC=cluster._2, CornerD=cluster._3)  # -> simplify(Surface)
_4point_surface_11 = _4PointSurface(CornerA=cluster_2._0, CornerB=cluster_2._2, CornerC=area_3.Centroid)  # -> simplify(Surface)
_4point_surface_12 = _4PointSurface(CornerA=cluster_3._0, CornerB=cluster_3._2, CornerC=area_3.Centroid)  # -> simplify(Surface)
_4point_surface_13 = _4PointSurface(CornerA=cluster_4._0, CornerB=cluster_4._2, CornerC=area_3.Centroid)  # -> simplify(Surface)
_4point_surface_14 = _4PointSurface(CornerA=cluster_5._0, CornerB=cluster_5._2, CornerC=area_3.Centroid)  # -> simplify(Surface)
surface_frames = SurfaceFrames(Surface=plane_surface, UCount=expr("x-1", number_slider_3), VCount=expr("x-1", number_slider_4))  # -> simplify(flatten(Frames)), Parameters
graft_tree = GraftTree(Tree=surface_frames.Frames, IncludeEmptyLists=True, IncludeNullItems=True)  # -> simplify(Tree)
brep = Brep([rotate_axis_4.Geometry, rotate_axis_3.Geometry, rotate_axis_2.Geometry, rotate_axis.Geometry, _4point_surface_10, _4point_surface_9, _4point_surface_8, _4point_surface_7, _4point_surface_6, _4point_surface_11, _4point_surface_12, _4point_surface_13, _4point_surface_14])
brep_join = BrepJoin(Breps=brep)  # -> Breps, Closed
unit_x_2 = UnitX(Factor=Slider(12.2, range=0..20))
point_3 = Point(flatten(graft_tree))
list_length = ListLength(List=brep)  # -> flatten(Length)
point_4 = Point(graft_tree)
move_7 = Move(Geometry=graft_tree, Motion=unit_x_2)  # -> Geometry, Transform
list_item_14 = ListItem(List=list_length, Index=0, Wrap=True)
list_length_2 = ListLength(List=point_3)
is_planar = IsPlanar(Surface=brep, Interior=True)  # -> Planar, Plane
series_3 = Series(Start=0, Step=1, Count=list_length_2)
polar_array = PolarArray(Geometry=move_7.Geometry, Plane=point_4, Count=list_item_14, Angle=6.283185307)  # -> simplify(Geometry), Transform
integer = Integer(series_3)
text_tag_3d = TextTag3D(Location=point_3, Text=integer, Size=Slider(4.5, range=0..10), Justification=5)
orient = Orient(Geometry=brep, Source=is_planar.Plane, Target=polar_array.Geometry)  # -> Geometry, Transform
integer_2 = Integer(1)
series_4 = Series(Start=integer_2, Step=1, Count=list_item_14)
area_4 = Area(Geometry=orient.Geometry)  # -> Area, Centroid
integer_3 = Integer(series_4)
text_tag_3d_2 = TextTag3D(Location=area_4.Centroid, Text=integer_3, Size=Slider(2.1, range=0..10), Justification=5)

# ==== cluster Cluster
point = ClusterInput()
point_2 = Point(point)
integer = Integer(0)
integer_2 = Integer(1)
integer_3 = Integer(2)
integer_4 = Integer(3)
list_item = ListItem(List=point_2, Index=integer, Wrap=True)
list_item_2 = ListItem(List=point_2, Index=integer_2, Wrap=True)
list_item_3 = ListItem(List=point_2, Index=integer_3, Wrap=True)
list_item_4 = ListItem(List=point_2, Index=integer_4, Wrap=True)
_0 = ClusterOutput(list_item)
_1 = ClusterOutput(list_item_2)
_2 = ClusterOutput(list_item_3)
_3 = ClusterOutput(list_item_4)

# ==== cluster Cluster_2
point = ClusterInput()
point_2 = Point(point)
integer = Integer(0)
integer_2 = Integer(1)
integer_3 = Integer(2)
list_item = ListItem(List=point_2, Index=integer, Wrap=True)
list_item_2 = ListItem(List=point_2, Index=integer_2, Wrap=True)
list_item_3 = ListItem(List=point_2, Index=integer_3, Wrap=True)
_0 = ClusterOutput(list_item)
_1 = ClusterOutput(list_item_2)
_2 = ClusterOutput(list_item_3)
