# Grasshopper definition T12.3.gh (Grasshopper 1.0.8)

number_slider = Slider(19, range=0..100)
number_slider_2 = Slider(4, range=0..100)
series = Series(Start=0, Step=number_slider, Count=number_slider_2)
construct_point = ConstructPoint(XCoordinate=series, YCoordinate=0, ZCoordinate=0)
point = Point(construct_point)
list_item = ListItem(List=reverse(point), Index=0, Wrap=True)
list_item_2 = ListItem(List=point, Index=0, Wrap=True)
series_2 = Series(Start=list_item_2, Step=number_slider, Count=number_slider_2)
distance = Distance(PointA=list_item, PointB=list_item_2)
construct_point_2 = ConstructPoint(XCoordinate=0, YCoordinate=series_2, ZCoordinate=0)
unit_y = UnitY(Factor=distance)
point_2 = Point(construct_point_2)
move = Move(Geometry=point, Motion=unit_y)  # -> Geometry, Transform
list_item_3 = ListItem(List=reverse(point_2), Index=0, Wrap=True)
list_item_4 = ListItem(List=point_2, Index=0, Wrap=True)
distance_2 = Distance(PointA=list_item_3, PointB=list_item_4)
gene_pool = GenePool(Decimals=0, Maximum=40, Minimum=0, Value=[23, 17])
gene_pool_2 = GenePool(Decimals=0, Maximum=40, Minimum=0, Value=[19, 23, 22])
gene_pool_3 = GenePool(Decimals=0, Maximum=40, Minimum=0, Value=[23, 26, 18, 23])
gene_pool_4 = GenePool(Decimals=0, Maximum=40, Minimum=0, Value=[22, 26, 20])
unit_x = UnitX(Factor=distance_2)
unit_z = UnitZ(Factor=gene_pool)
list_item_5 = ListItem(List=reverse(gene_pool_3), Index=0, Wrap=True)
move_2 = Move(Geometry=point_2, Motion=unit_x)  # -> Geometry, Transform
unit_z_2 = UnitZ(Factor=gene_pool_4)
list_item_6 = ListItem(List=gene_pool_3, Index=0, Wrap=True)
list_item_7 = ListItem(List=gene_pool_4, Index=0, Wrap=True)
list_item_8 = ListItem(List=gene_pool_2, Index=0, Wrap=True)
unit_z_3 = UnitZ(Factor=[list_item_5, unit_z])
unit_z_4 = UnitZ(Factor=reverse(gene_pool_2))
unit_z_5 = UnitZ(Factor=gene_pool_3)
unit_z_6 = UnitZ(Factor=list_item_6)
unit_z_7 = UnitZ(Factor=list_item_8)
unit_z_8 = UnitZ(Factor=list_item_7)
move_3 = Move(Geometry=reverse(move.Geometry), Motion=[unit_z_3, unit_z_7])  # -> Geometry, Transform
move_4 = Move(Geometry=move_2.Geometry, Motion=unit_z_5)  # -> Geometry, Transform
move_5 = Move(Geometry=point_2, Motion=[unit_z_8, unit_z_4])  # -> Geometry, Transform
move_6 = Move(Geometry=point, Motion=[unit_z_2, unit_z_6])  # -> Geometry, Transform
interpolate = Interpolate(Vertices=move_4.Geometry, Degree=3, Periodic=False, KnotStyle=1)  # -> Curve, Length, Domain
interpolate_2 = Interpolate(Vertices=move_3.Geometry, Degree=3, Periodic=False, KnotStyle=1)  # -> Curve, Length, Domain
interpolate_3 = Interpolate(Vertices=move_5.Geometry, Degree=3, Periodic=False, KnotStyle=1)  # -> Curve, Length, Domain
interpolate_4 = Interpolate(Vertices=move_6.Geometry, Degree=3, Periodic=False, KnotStyle=1)  # -> Curve, Length, Domain
network_surface = NetworkSurface(CurvesU=[interpolate_3.Curve, interpolate.Curve], CurvesV=[interpolate_4.Curve, interpolate_2.Curve], Continuity=2)
number_slider_3 = Slider(15, range=0..100)
surface = Surface(reparameterize(network_surface))
divide_surface = DivideSurface(Surface=surface, UCount=number_slider_3, VCount=number_slider_3)  # -> simplify(flatten(Points)), simplify(flatten(Normals)), simplify(flatten(Parameters))
image_sampler = ImageSampler(divide_surface.Parameters, Filter="Colour", Interpolate=False, Umax=1, Umin=0, Vmax=1, Vmin=0, Wrap=1)
bounds = Bounds(Numbers=image_sampler)
construct_domain = ConstructDomain(DomainStart=Slider(28.8, range=0..100), DomainEnd=Slider(57, range=0..100))
remap_numbers = RemapNumbers(Value=image_sampler, Source=bounds, Target=construct_domain)  # -> Mapped, Clipped
unit_z_9 = UnitZ(Factor=remap_numbers.Mapped)
move_7 = Move(Geometry=divide_surface.Points, Motion=unit_z_9)  # -> Geometry, Transform
surface_from_points = SurfaceFromPoints(Points=move_7.Geometry, UCount=expr("x+1", number_slider_3), Interpolate=False)
