# Grasshopper definition T14.3.gh (Grasshopper 1.0.8)

md_slider = MDSlider(
    SliderMode=0,
    slider_value=Point(0.2023882052, 0.4031502328, 0.5),
    x_domain=Domain(0, 1),
    y_domain=Domain(0, 1),
    z_domain=Domain(0, 1))
md_slider_2 = MDSlider(
    SliderMode=0,
    slider_value=Point(0.2798781976, 0.433119611, 0.5),
    x_domain=Domain(0, 1),
    y_domain=Domain(0, 1),
    z_domain=Domain(0, 1))
surface = Surface(reparameterize(<surface referenced from the Rhino model>))
evaluate_surface = EvaluateSurface(Surface=surface, Point=[md_slider, md_slider_2])  # -> Point, Normal, UDirection, VDirection, Frame
deconstruct_brep = DeconstructBrep(Brep=surface)  # -> Faces, Edges, simplify(Vertices)
point = Point(deconstruct_brep.Vertices)
vector_xyz = VectorXYZ(XComponent=0, YComponent=0, ZComponent=0)  # -> Vector, Length
list_length = ListLength(List=point)
multiplication = Multiplication(A=evaluate_surface.Normal, B=[Slider(2.1, range=0..10), Slider(8.76, range=0..10)])
repeat_data = RepeatData(Data=vector_xyz.Vector, Length=list_length)
vector = Vector(flatten(repeat_data))
point_2 = Point(flatten(deconstruct_brep.Vertices))
point_3 = Point(flatten(evaluate_surface.Point))
vector_2 = Vector(flatten(multiplication))
point_4 = Point([point_3, point_2])
vector_3 = Vector([vector_2, vector])
spatial_deform_custom = SpatialDeformCustom(Geometry=surface, Syntax=point_4, Forces=expr("-x", vector_3), Falloff="1.0/x^2")
