# Grasshopper definition T15.1.gh (Grasshopper 1.0.8)

number_slider = Slider(12, range=0..100)
number_slider_2 = Slider(13, range=0..100)
number_slider_3 = Slider(24, range=0..100)
unit_x = UnitX(Factor=number_slider)
unit_y = UnitY(Factor=number_slider_2)
unit_z = UnitZ(Factor=number_slider_3)
xy_plane = XYPlane(Origin=Point(0, 0, 0))
addition = Addition(A=unit_x, B=unit_y, C=unit_z)
brep = Brep(<brep referenced from the Rhino model>)
move = Move(Geometry=xy_plane, Motion=addition)  # -> Geometry, Transform
bounding_box = BoundingBox(Content=brep, Plane=PlaneXY(0, 0, 0))  # -> Box, Box_2
center_box = CenterBox(Base=move.Geometry, X=number_slider, Y=number_slider_2, Z=number_slider_3)
box_morph = BoxMorph(Geometry=brep, Reference=bounding_box.Box, Target=center_box)
bounding_box_2 = BoundingBox(Content=box_morph, Plane=PlaneXY(0, 0, 0))  # -> Box, Box_2
deconstruct_brep = DeconstructBrep(Brep=bounding_box_2.Box)  # -> Faces, Edges, Vertices
list_item = ListItem(List=deconstruct_brep.Faces, Index="5", Wrap=True)
unit_z_2 = UnitZ(Factor=Slider(10, range=0..100))
box_corners = BoxCorners(Box=bounding_box_2.Box)  # -> CornerA, CornerB, CornerC, CornerD, CornerE, CornerF, CornerG, CornerH
move_2 = Move(Geometry=list_item, Motion=unit_z_2)  # -> Geometry, Transform
unit_z_3 = UnitZ(Factor=1)
area = Area(Geometry=move_2.Geometry)  # -> Area, Centroid
rotate_3d = Rotate3D(Geometry=move_2.Geometry, Angle=degrees(Slider(60, range=0..180)), Center=area.Centroid, Axis=unit_z_3)  # -> Geometry, Transform
unit_x_2 = UnitX(Factor=1)
rotate_3d_2 = Rotate3D(Geometry=rotate_3d.Geometry, Angle=degrees(Slider(40, range=0..180)), Center=area.Centroid, Axis=unit_x_2)  # -> Geometry, Transform
unit_y_2 = UnitY(Factor=1)
rotate_3d_3 = Rotate3D(Geometry=rotate_3d_2.Geometry, Angle=degrees(Slider(0, range=0..180)), Center=area.Centroid, Axis=unit_y_2)  # -> Geometry, Transform
is_planar = IsPlanar(Surface=rotate_3d_3.Geometry, Interior=True)  # -> Planar, Plane
scale_nu = ScaleNU(
    Geometry=rotate_3d_3.Geometry,
    Plane=is_planar.Plane,
    ScaleX=Slider(0.9, range=0..10),
    ScaleY=Slider(1, range=0..10),
    ScaleZ=1)  # -> Geometry, Transform
deconstruct_brep_2 = DeconstructBrep(Brep=scale_nu.Geometry)  # -> Faces, Edges, Vertices
cluster = Cluster(point=deconstruct_brep_2.Vertices)  # -> _0, _1, _2, _3
twisted_box = TwistedBox(
    CornerA=box_corners.CornerA,
    CornerB=box_corners.CornerB,
    CornerC=box_corners.CornerC,
    CornerD=box_corners.CornerD,
    CornerE=cluster._0,
    CornerF=cluster._1,
    CornerG=cluster._2,
    CornerH=cluster._3)
box_morph_2 = BoxMorph(Geometry=brep, Reference=bounding_box.Box, Target=twisted_box)

# ==== cluster Cluster
point = ClusterInput()
point_2 = Point(point)
integer = Integer(0)
integer_2 = Integer(1)
integer_3 = Integer(2)
integer_4 = Integer(3)
list_item = ListItem(List=point_2, Index=integer, Wrap=True)
list_item_2 = ListItem(List=point_2, Index=integer_2, Wrap=True)
list_item_3 = ListItem(List=point_2, Index=integer_3, Wrap=True)
list_item_4 = ListItem(List=point_2, Index=integer_4, Wrap=True)
_0 = ClusterOutput(list_item)
_1 = ClusterOutput(list_item_2)
_2 = ClusterOutput(list_item_3)
_3 = ClusterOutput(list_item_4)
