# Grasshopper definition T15.2.gh (Grasshopper 1.0.8)

brep = Brep(<brep referenced from the Rhino model>)
box_corners = BoxCorners(Box=brep)  # -> CornerA, CornerB, CornerC, CornerD, CornerE, CornerF, CornerG, CornerH
number_slider = Slider(11, range=0..100)
vector_2pt = Vector2Pt(PointA=box_corners.CornerA, PointB=box_corners.CornerE, Unitize=False)  # -> Vector, Length
division = Division(A=vector_2pt.Length, B=number_slider)
expression = Expression(x=division, Expression="x - 0.01")
construct_domain = ConstructDomain(DomainStart=0, DomainEnd=Slider(180, range=0..180))
contour = Contour(Shape=brep, Point=box_corners.CornerA, Direction=vector_2pt.Vector, Distance=expression)  # -> flatten(Contours)
unit_z = UnitZ(Factor=1)
range = Range(Domain=construct_domain, Steps=number_slider)
area = Area(Geometry=contour)  # -> Area, Centroid
construct_domain_2 = ConstructDomain(DomainStart=0, DomainEnd=Slider(13, range=0..180))
rotate_3d = Rotate3D(Geometry=contour, Angle=degrees(range), Center=area.Centroid, Axis=unit_z)  # -> Geometry, Transform
range_2 = Range(Domain=construct_domain_2, Steps=number_slider)
unit_x = UnitX(Factor=1)
construct_domain_3 = ConstructDomain(DomainStart=0, DomainEnd=Slider(13, range=0..180))
rotate_3d_2 = Rotate3D(Geometry=rotate_3d.Geometry, Angle=degrees(range_2), Center=area.Centroid, Axis=unit_x)  # -> Geometry, Transform
range_3 = Range(Domain=construct_domain_3, Steps=number_slider)
unit_y = UnitY(Factor=1)
rotate_3d_3 = Rotate3D(Geometry=rotate_3d_2.Geometry, Angle=degrees(range_3), Center=area.Centroid, Axis=unit_y)  # -> Geometry, Transform
construct_domain_4 = ConstructDomain(DomainStart=Slider(0.2, range=0..1), DomainEnd=Slider(1.3, range=0..5))
range_4 = Range(Domain=construct_domain_4, Steps=number_slider)
scale = Scale(Geometry=rotate_3d_3.Geometry, Center=area.Centroid, Factor=range_4)  # -> Geometry, Transform
loft = Loft(Curves=scale.Geometry, Options={Adjust=False, Closed=False, LoftEnds=0, LoftSimp=0, LoftType=0, Rebuild=10, Refit=0.01})
cap_holes = CapHoles(Brep=loft)
